# Dynamo graph Sheet-Exporter.dyn "Sheet Exporter" (Dynamo 3.0.3.7597)
# Pick sheets in a dialog and export one PDF and/or one DWG per sheet (Revit 2025).

sheet_exporter = Python()  # CPython3; graph output; unwired: IN[0]
# ---------- sheet_exporter.python (999 lines) ----------
# Sheet Exporter for Revit 2025 (Dynamo 3.x, CPython3)
# Opens one dialog: pick sheets (search + saved sheet sets), choose PDF options
# (same as Revit's native PDF exporter), a DWG export setup, a file-name pattern
# and an output folder. Exports one PDF and/or one DWG per sheet. DWGs are
# exported with merged views, so no xref files are created.

import clr
import os
import re
import json
import traceback

clr.AddReference('System')
clr.AddReference('System.Windows.Forms')
clr.AddReference('System.Drawing')
import System
from System.Collections.Generic import List
import System.Windows.Forms as WF
import System.Drawing as SD

clr.AddReference('RevitAPI')
from Autodesk.Revit.DB import (FilteredElementCollector, ViewSheet, ViewSheetSet,
                               ViewSet, ElementId, PDFExportOptions, DWGExportOptions,
                               BaseExportOptions, ExportPDFSettings, ExportPaperFormat,
                               PageOrientationType, PaperPlacementType, ZoomType,
                               RasterQualityType, ColorDepthType, PrintRange,
                               StorageType)

clr.AddReference('RevitServices')
from RevitServices.Persistence import DocumentManager
from RevitServices.Transactions import TransactionManager

doc = DocumentManager.Instance.CurrentDBDocument

# --------------------------------------------------------------------------
# Settings persistence
# --------------------------------------------------------------------------
SETTINGS_DIR = os.path.join(os.environ.get('APPDATA', os.path.expanduser('~')), 'DynamoSheetExporter')
SETTINGS_FILE = os.path.join(SETTINGS_DIR, 'settings.json')

DEFAULTS = {
    'pattern': '{Sheet Number} - {Sheet Name}',
    'folder': os.path.join(os.path.expanduser('~'), 'Documents', 'Sheet Exports'),
    'export_pdf': True,
    'export_dwg': True,
    'dwg_setup': '',
    'paper_format': 'Default',
    'orientation': 'Auto',
    'placement': 'Center',
    'offset_x': 0.0,
    'offset_y': 0.0,
    'zoom_fit': True,
    'zoom_pct': 100,
    'raster_hidden': False,
    'raster_quality': 'High',
    'color_depth': 'Color',
    'links_blue': False,
    'hide_ref': True,
    'hide_tags': True,
    'hide_scope': True,
    'hide_crop': True,
    'halftone_thin': False,
    'mask_lines': False,
}


def load_settings():
    s = dict(DEFAULTS)
    try:
        with open(SETTINGS_FILE, 'r') as f:
            s.update(json.load(f))
    except Exception:
        pass
    return s


def save_settings(s):
    try:
        if not os.path.isdir(SETTINGS_DIR):
            os.makedirs(SETTINGS_DIR)
        with open(SETTINGS_FILE, 'w') as f:
            json.dump(s, f, indent=2)
    except Exception:
        pass


def doc_key():
    return doc.PathName or doc.Title


# --------------------------------------------------------------------------
# Revit helpers
# --------------------------------------------------------------------------
def enum_names(enum_type):
    # Type.GetEnumNames avoids pythonnet picking the generic Enum.GetNames<TEnum>()
    return [str(n) for n in clr.GetClrType(enum_type).GetEnumNames()]


def enum_value(enum_type, name):
    return getattr(enum_type, name)


def get_links_blue(o):
    for n in ('ViewLinksInBlue', 'ViewLinksinBlue'):
        if hasattr(o, n):
            return bool(getattr(o, n))
    return False


def set_links_blue(o, val):
    for n in ('ViewLinksInBlue', 'ViewLinksinBlue'):
        if hasattr(o, n):
            setattr(o, n, val)
            return


def enum_name(enum_type, value):
    try:
        t = clr.GetClrType(enum_type)
        for n in t.GetEnumNames():
            if getattr(enum_type, str(n)) == value:
                return str(n)
    except Exception:
        pass
    return str(value)


def get_sheets():
    sheets = [s for s in FilteredElementCollector(doc).OfClass(ViewSheet)
              if not s.IsPlaceholder]
    sheets.sort(key=lambda s: s.SheetNumber)
    return sheets


def get_sheet_sets():
    sets = {}
    for vss in FilteredElementCollector(doc).OfClass(ViewSheetSet):
        nums = []
        for v in vss.Views:
            if isinstance(v, ViewSheet):
                nums.append(v.SheetNumber)
        sets[vss.Name] = (vss, nums)
    return sets


def sheet_param_names(sheets):
    names = set(['Sheet Number', 'Sheet Name'])
    for s in sheets[:50]:
        for p in s.Parameters:
            try:
                names.add(p.Definition.Name)
            except Exception:
                pass
    return sorted(names, key=lambda n: n.lower())


def param_value(sheet, name):
    p = sheet.LookupParameter(name)
    if p is None:
        if name == 'Sheet Number':
            return sheet.SheetNumber
        if name == 'Sheet Name':
            return sheet.Name
        return ''
    if p.StorageType == StorageType.String:
        return p.AsString() or ''
    return p.AsValueString() or ''


INVALID = re.compile(r'[\\/:*?"<>|]')


def build_name(sheet, pattern):
    def repl(m):
        return param_value(sheet, m.group(1))
    name = re.sub(r'\{([^{}]+)\}', repl, pattern)
    name = INVALID.sub('_', name).strip().rstrip('.')
    return name or sheet.SheetNumber


# --------------------------------------------------------------------------
# UI helpers
# --------------------------------------------------------------------------
FONT = SD.Font('Segoe UI', 9.0)


def label(parent, text, x, y, w=120, h=20):
    c = WF.Label()
    c.Text = text
    c.Location = SD.Point(x, y + 3)
    c.Size = SD.Size(w, h)
    parent.Controls.Add(c)
    return c


def combo(parent, items, x, y, w=180):
    c = WF.ComboBox()
    c.DropDownStyle = WF.ComboBoxStyle.DropDownList
    c.Location = SD.Point(x, y)
    c.Size = SD.Size(w, 24)
    for i in items:
        c.Items.Add(i)
    parent.Controls.Add(c)
    return c


def set_combo(c, value):
    idx = c.Items.IndexOf(value)
    if idx < 0 and c.Items.Count > 0:
        idx = 0
    c.SelectedIndex = idx


def check(parent, text, x, y, w=260):
    c = WF.CheckBox()
    c.Text = text
    c.Location = SD.Point(x, y)
    c.Size = SD.Size(w, 22)
    parent.Controls.Add(c)
    return c


def button(parent, text, x, y, w=80, h=26):
    c = WF.Button()
    c.Text = text
    c.Location = SD.Point(x, y)
    c.Size = SD.Size(w, h)
    parent.Controls.Add(c)
    return c


def numeric(parent, x, y, mn, mx, val, dec=0, w=70):
    c = WF.NumericUpDown()
    c.Location = SD.Point(x, y)
    c.Size = SD.Size(w, 24)
    c.DecimalPlaces = dec
    c.Minimum = System.Decimal(mn)
    c.Maximum = System.Decimal(mx)
    c.Value = System.Decimal(max(mn, min(mx, val)))
    parent.Controls.Add(c)
    return c


def num_val(c):
    return float(str(c.Value).replace(',', '.'))


def group(parent, text, x, y, w, h):
    g = WF.GroupBox()
    g.Text = text
    g.Location = SD.Point(x, y)
    g.Size = SD.Size(w, h)
    parent.Controls.Add(g)
    return g


def ask_text(title, prompt, default=''):
    f = WF.Form()
    f.Text = title
    f.Font = FONT
    f.FormBorderStyle = WF.FormBorderStyle.FixedDialog
    f.StartPosition = WF.FormStartPosition.CenterParent
    f.MinimizeBox = False
    f.MaximizeBox = False
    f.ClientSize = SD.Size(360, 110)
    label(f, prompt, 12, 10, 330)
    tb = WF.TextBox()
    tb.Location = SD.Point(12, 38)
    tb.Size = SD.Size(334, 24)
    tb.Text = default
    f.Controls.Add(tb)
    ok = button(f, 'OK', 186, 74)
    ok.DialogResult = WF.DialogResult.OK
    cancel = button(f, 'Cancel', 270, 74)
    cancel.DialogResult = WF.DialogResult.Cancel
    f.AcceptButton = ok
    f.CancelButton = cancel
    if f.ShowDialog() == WF.DialogResult.OK and tb.Text.strip():
        return tb.Text.strip()
    return None


def msg(text, icon=WF.MessageBoxIcon.Information, buttons=WF.MessageBoxButtons.OK):
    return WF.MessageBox.Show(text, 'Sheet Exporter', buttons, icon)


# --------------------------------------------------------------------------
# Data
# --------------------------------------------------------------------------
settings = load_settings()
sheets = get_sheets()
sheet_by_num = dict((s.SheetNumber, s) for s in sheets)
checked = dict((s.SheetNumber, False) for s in sheets)

pdf_setup_names = []
try:
    pdf_setup_names = sorted([s.Name for s in FilteredElementCollector(doc).OfClass(ExportPDFSettings)])
except Exception:
    pass

dwg_setup_names = []
try:
    dwg_setup_names = list(BaseExportOptions.GetPredefinedSetupNames(doc))
except Exception:
    pass

PAPER_FORMATS = enum_names(ExportPaperFormat)
PAPER_LABELS = ['Use sheet size' if p == 'Default' else p for p in PAPER_FORMATS]
ORIENTATIONS = ['Auto', 'Portrait', 'Landscape']
RASTER_Q = ['Low', 'Medium', 'High', 'Presentation']
COLORS = [('Color', 'Color'), ('Grayscale', 'GrayScale'), ('Black lines', 'BlackLine')]

state = {'result': None, 'filling': False}

# --------------------------------------------------------------------------
# Form
# --------------------------------------------------------------------------
form = WF.Form()
form.SuspendLayout()
form.AutoScaleDimensions = SD.SizeF(96.0, 96.0)
form.AutoScaleMode = WF.AutoScaleMode.Dpi
form.Text = 'Sheet Exporter - ' + doc.Title
form.Font = FONT
form.FormBorderStyle = WF.FormBorderStyle.FixedDialog
form.MaximizeBox = False
form.StartPosition = WF.FormStartPosition.CenterScreen
form.ClientSize = SD.Size(1000, 690)

# ---- Sheets (left) --------------------------------------------------------
gs = group(form, 'Sheets', 10, 8, 440, 630)
label(gs, 'Search', 10, 22, 50)
search = WF.TextBox()
search.Location = SD.Point(64, 22)
search.Size = SD.Size(366, 24)
gs.Controls.Add(search)

label(gs, 'Sheet set', 10, 54, 60)
set_combo_ctl = combo(gs, [], 74, 54, 166)
btn_apply = button(gs, 'Select', 246, 53, 58)
btn_save = button(gs, 'Save as...', 308, 53, 70)
btn_del = button(gs, 'Delete', 382, 53, 50)

clb = WF.CheckedListBox()
clb.Location = SD.Point(10, 88)
clb.Size = SD.Size(420, 500)
clb.CheckOnClick = True
clb.IntegralHeight = False
clb.HorizontalScrollbar = True
gs.Controls.Add(clb)

btn_all = button(gs, 'All', 10, 594, 60)
btn_none = button(gs, 'None', 74, 594, 60)
count_lbl = label(gs, '', 146, 594, 284)

visible_nums = []


def sheet_label(s):
    return s.SheetNumber + '  -  ' + s.Name


def refresh_list(*args):
    state['filling'] = True
    clb.BeginUpdate()
    clb.Items.Clear()
    del visible_nums[:]
    q = search.Text.strip().lower()
    widest = 0
    for s in sheets:
        text = sheet_label(s)
        if q and q not in text.lower():
            continue
        visible_nums.append(s.SheetNumber)
        idx = clb.Items.Add(text)
        widest = max(widest, WF.TextRenderer.MeasureText(text, clb.Font).Width)
        if checked[s.SheetNumber]:
            clb.SetItemChecked(idx, True)
    clb.HorizontalExtent = widest + 30   # room for the checkbox
    clb.EndUpdate()
    state['filling'] = False
    update_count()


def update_count():
    n = sum(1 for v in checked.values() if v)
    count_lbl.Text = '%d of %d sheets selected' % (n, len(sheets))
    update_preview()


def on_item_check(sender, e):
    if state['filling']:
        return
    num = visible_nums[e.Index]
    checked[num] = (e.NewValue == WF.CheckState.Checked)
    # count updates after the check state actually changes
    form.BeginInvoke(System.Action(update_count))


def set_visible(val):
    for n in visible_nums:
        checked[n] = val
    refresh_list()


def reload_sets(select=None):
    set_combo_ctl.Items.Clear()
    for name in sorted(get_sheet_sets().keys(), key=lambda n: n.lower()):
        set_combo_ctl.Items.Add(name)
    if select and set_combo_ctl.Items.IndexOf(select) >= 0:
        set_combo_ctl.SelectedIndex = set_combo_ctl.Items.IndexOf(select)
    elif set_combo_ctl.Items.Count > 0:
        set_combo_ctl.SelectedIndex = 0


def on_apply_set(sender, e):
    name = set_combo_ctl.SelectedItem
    if name is None:
        return
    sets = get_sheet_sets()
    if name not in sets:
        return
    nums = set(sets[name][1])
    for n in checked:
        checked[n] = n in nums
    refresh_list()


def on_save_set(sender, e):
    nums = [n for n, v in checked.items() if v]
    if not nums:
        msg('Select at least one sheet first.', WF.MessageBoxIcon.Warning)
        return
    name = ask_text('Save sheet set', 'Name for the sheet set (saved in this Revit model):',
                    set_combo_ctl.SelectedItem or '')
    if not name:
        return
    sets = get_sheet_sets()
    if name in sets:
        if msg('A sheet set named "%s" already exists. Replace it?' % name,
               WF.MessageBoxIcon.Question, WF.MessageBoxButtons.YesNo) != WF.DialogResult.Yes:
            return
    try:
        vs = ViewSet()
        for n in nums:
            vs.Insert(sheet_by_num[n])
        TransactionManager.Instance.EnsureInTransaction(doc)
        pm = doc.PrintManager
        pm.PrintRange = PrintRange.Select
        vsetting = pm.ViewSheetSetting
        if name in sets:
            vsetting.CurrentViewSheetSet = sets[name][0]
            vsetting.CurrentViewSheetSet.Views = vs
            vsetting.Save()
        else:
            vsetting.CurrentViewSheetSet.Views = vs
            vsetting.SaveAs(name)
        TransactionManager.Instance.TransactionTaskDone()
        TransactionManager.Instance.ForceCloseTransaction()
        reload_sets(name)
    except Exception as ex:
        try:
            TransactionManager.Instance.ForceCloseTransaction()
        except Exception:
            pass
        msg('Could not save the sheet set:\n' + str(ex), WF.MessageBoxIcon.Error)


def on_delete_set(sender, e):
    name = set_combo_ctl.SelectedItem
    if name is None:
        return
    if msg('Delete the sheet set "%s" from this Revit model?' % name,
           WF.MessageBoxIcon.Question, WF.MessageBoxButtons.YesNo) != WF.DialogResult.Yes:
        return
    sets = get_sheet_sets()
    if name not in sets:
        return
    try:
        TransactionManager.Instance.EnsureInTransaction(doc)
        doc.Delete(sets[name][0].Id)
        TransactionManager.Instance.TransactionTaskDone()
        TransactionManager.Instance.ForceCloseTransaction()
        reload_sets()
    except Exception as ex:
        try:
            TransactionManager.Instance.ForceCloseTransaction()
        except Exception:
            pass
        msg('Could not delete the sheet set:\n' + str(ex), WF.MessageBoxIcon.Error)


search.TextChanged += refresh_list
clb.ItemCheck += on_item_check
btn_all.Click += lambda s, e: set_visible(True)
btn_none.Click += lambda s, e: set_visible(False)
btn_apply.Click += on_apply_set
btn_save.Click += on_save_set
btn_del.Click += on_delete_set

# ---- PDF (right top) ------------------------------------------------------
gp = group(form, 'PDF options (same as Revit\'s PDF export)', 460, 8, 530, 370)
chk_pdf = check(gp, 'Export PDF (one file per sheet)', 12, 20, 250)
label(gp, 'Load project setup', 270, 20, 120)
pdf_setup = combo(gp, ['<current settings>'] + pdf_setup_names, 390, 20, 130)

label(gp, 'Paper format', 12, 52, 100)
paper = combo(gp, PAPER_LABELS, 112, 52, 150)
label(gp, 'Orientation', 280, 52, 80)
orient = combo(gp, ORIENTATIONS, 362, 52, 100)

label(gp, 'Placement', 12, 84, 100)
place_center = WF.RadioButton()
place_center.Text = 'Center'
place_center.Location = SD.Point(112, 84)
place_center.Size = SD.Size(70, 22)
place_offset = WF.RadioButton()
place_offset.Text = 'Offset from corner'
place_offset.Location = SD.Point(186, 84)
place_offset.Size = SD.Size(130, 22)
gp.Controls.Add(place_center)
gp.Controls.Add(place_offset)
label(gp, 'X', 322, 84, 14)  # offsets shown in mm
off_x = numeric(gp, 338, 84, -1000, 1000, settings['offset_x'], 1, 66)
label(gp, 'Y', 410, 84, 14)
off_y = numeric(gp, 426, 84, -1000, 1000, settings['offset_y'], 1, 66)
label(gp, 'mm', 494, 84, 30)

label(gp, 'Zoom', 12, 116, 100)
pnl_zoom = WF.Panel()
pnl_zoom.Location = SD.Point(112, 114)
pnl_zoom.Size = SD.Size(300, 28)
gp.Controls.Add(pnl_zoom)
zoom_fit = WF.RadioButton()
zoom_fit.Text = 'Fit to page'
zoom_fit.Location = SD.Point(0, 2)
zoom_fit.Size = SD.Size(90, 22)
zoom_pct_rb = WF.RadioButton()
zoom_pct_rb.Text = 'Zoom'
zoom_pct_rb.Location = SD.Point(96, 2)
zoom_pct_rb.Size = SD.Size(60, 22)
pnl_zoom.Controls.Add(zoom_fit)
pnl_zoom.Controls.Add(zoom_pct_rb)
zoom_pct = numeric(pnl_zoom, 158, 2, 1, 1000, settings['zoom_pct'], 0, 60)
label(pnl_zoom, '%', 222, 0, 20)

label(gp, 'Hidden line views', 12, 150, 100)
pnl_hl = WF.Panel()
pnl_hl.Location = SD.Point(112, 148)
pnl_hl.Size = SD.Size(300, 28)
gp.Controls.Add(pnl_hl)
hl_vector = WF.RadioButton()
hl_vector.Text = 'Vector processing'
hl_vector.Location = SD.Point(0, 2)
hl_vector.Size = SD.Size(130, 22)
hl_raster = WF.RadioButton()
hl_raster.Text = 'Raster processing'
hl_raster.Location = SD.Point(136, 2)
hl_raster.Size = SD.Size(130, 22)
pnl_hl.Controls.Add(hl_vector)
pnl_hl.Controls.Add(hl_raster)

label(gp, 'Raster quality', 12, 184, 100)
rq = combo(gp, RASTER_Q, 112, 184, 150)
label(gp, 'Colors', 280, 184, 60)
colors = combo(gp, [c[0] for c in COLORS], 342, 184, 120)

chk_links = check(gp, 'View links in blue', 12, 220, 240)
chk_ref = check(gp, 'Hide ref/work planes', 12, 244, 240)
chk_tags = check(gp, 'Hide unreferenced view tags', 12, 268, 240)
chk_scope = check(gp, 'Hide scope boxes', 12, 292, 240)
chk_crop = check(gp, 'Hide crop boundaries', 270, 220, 250)
chk_half = check(gp, 'Replace halftone with thin lines', 270, 244, 250)
chk_mask = check(gp, 'Region edges mask coincident lines', 270, 268, 250)


def update_pdf_enabled(*args):
    on = chk_pdf.Checked
    for c in (pdf_setup, paper, orient, place_center, place_offset, pnl_zoom, pnl_hl,
              rq, colors, chk_links, chk_ref, chk_tags, chk_scope, chk_crop, chk_half, chk_mask):
        c.Enabled = on
    orient.Enabled = on and paper.SelectedIndex > 0 and PAPER_FORMATS[paper.SelectedIndex] != 'Default'
    off_x.Enabled = on and place_offset.Checked
    off_y.Enabled = on and place_offset.Checked
    zoom_pct.Enabled = on and zoom_pct_rb.Checked


def fill_pdf(d):
    """d: dict with the same keys as settings."""
    pf = d.get('paper_format', 'Default')
    paper.SelectedIndex = PAPER_FORMATS.index(pf) if pf in PAPER_FORMATS else 0
    set_combo(orient, d.get('orientation', 'Auto'))
    place_center.Checked = d.get('placement', 'Center') == 'Center'
    place_offset.Checked = not place_center.Checked
    off_x.Value = System.Decimal(max(-1000.0, min(1000.0, float(d.get('offset_x', 0.0)))))
    off_y.Value = System.Decimal(max(-1000.0, min(1000.0, float(d.get('offset_y', 0.0)))))
    zoom_fit.Checked = bool(d.get('zoom_fit', True))
    zoom_pct_rb.Checked = not zoom_fit.Checked
    zoom_pct.Value = System.Decimal(int(max(1, min(1000, d.get('zoom_pct', 100)))))
    hl_raster.Checked = bool(d.get('raster_hidden', False))
    hl_vector.Checked = not hl_raster.Checked
    set_combo(rq, d.get('raster_quality', 'High'))
    cd = d.get('color_depth', 'Color')
    colors.SelectedIndex = [c[1] for c in COLORS].index(cd) if cd in [c[1] for c in COLORS] else 0
    chk_links.Checked = bool(d.get('links_blue', False))
    chk_ref.Checked = bool(d.get('hide_ref', True))
    chk_tags.Checked = bool(d.get('hide_tags', True))
    chk_scope.Checked = bool(d.get('hide_scope', True))
    chk_crop.Checked = bool(d.get('hide_crop', True))
    chk_half.Checked = bool(d.get('halftone_thin', False))
    chk_mask.Checked = bool(d.get('mask_lines', False))
    update_pdf_enabled()


def options_to_dict(o):
    return {
        'paper_format': enum_name(ExportPaperFormat, o.PaperFormat),
        'orientation': enum_name(PageOrientationType, o.PaperOrientation),
        'placement': enum_name(PaperPlacementType, o.PaperPlacement),
        'offset_x': o.OriginOffsetX * 304.8,   # API stores feet
        'offset_y': o.OriginOffsetY * 304.8,
        'zoom_fit': enum_name(ZoomType, o.ZoomType) == 'FitToPage',
        'zoom_pct': o.ZoomPercentage,
        'raster_hidden': o.AlwaysUseRaster,
        'raster_quality': enum_name(RasterQualityType, o.RasterQuality),
        'color_depth': enum_name(ColorDepthType, o.ColorDepth),
        'links_blue': get_links_blue(o),
        'hide_ref': o.HideReferencePlane,
        'hide_tags': o.HideUnreferencedViewTags,
        'hide_scope': o.HideScopeBoxes,
        'hide_crop': o.HideCropBoundaries,
        'halftone_thin': o.ReplaceHalftoneWithThinLines,
        'mask_lines': o.MaskCoincidentLines,
    }


def read_pdf_controls():
    return {
        'paper_format': PAPER_FORMATS[max(0, paper.SelectedIndex)],
        'orientation': orient.SelectedItem or 'Auto',
        'placement': 'Center' if place_center.Checked else 'LowerLeft',
        'offset_x': num_val(off_x),
        'offset_y': num_val(off_y),
        'zoom_fit': zoom_fit.Checked,
        'zoom_pct': int(num_val(zoom_pct)),
        'raster_hidden': hl_raster.Checked,
        'raster_quality': rq.SelectedItem or 'High',
        'color_depth': COLORS[max(0, colors.SelectedIndex)][1],
        'links_blue': chk_links.Checked,
        'hide_ref': chk_ref.Checked,
        'hide_tags': chk_tags.Checked,
        'hide_scope': chk_scope.Checked,
        'hide_crop': chk_crop.Checked,
        'halftone_thin': chk_half.Checked,
        'mask_lines': chk_mask.Checked,
    }


def on_pdf_setup(sender, e):
    if pdf_setup.SelectedIndex <= 0:
        return
    name = pdf_setup.SelectedItem
    try:
        ps = ExportPDFSettings.FindByName(doc, name)
        fill_pdf(options_to_dict(ps.GetOptions()))
    except Exception as ex:
        msg('Could not read the PDF setup "%s":\n%s' % (name, ex), WF.MessageBoxIcon.Warning)


pdf_setup.SelectedIndexChanged += on_pdf_setup
for c in (chk_pdf, place_offset, zoom_pct_rb):
    c.CheckedChanged += update_pdf_enabled
paper.SelectedIndexChanged += update_pdf_enabled

# ---- DWG (right middle) ---------------------------------------------------
gd = group(form, 'DWG options', 460, 384, 530, 84)
chk_dwg = check(gd, 'Export DWG (one file per sheet)', 12, 20, 250)
label(gd, 'Export setup', 270, 20, 80)
dwg_setup = combo(gd, ['<default settings>'] + dwg_setup_names, 352, 20, 168)
label(gd, 'Views on sheets are merged into each sheet\'s DWG, so no xref files are created.',
      12, 50, 510)
chk_dwg.CheckedChanged += lambda s, e: setattr(dwg_setup, 'Enabled', chk_dwg.Checked)

# ---- Output (right bottom) ------------------------------------------------
go = group(form, 'Output', 460, 474, 530, 164)
label(go, 'Folder', 12, 22, 70)
folder_tb = WF.TextBox()
folder_tb.Location = SD.Point(84, 22)
folder_tb.Size = SD.Size(346, 24)
go.Controls.Add(folder_tb)
btn_browse = button(go, 'Browse...', 436, 21, 84)

label(go, 'File name', 12, 56, 70)
pattern_tb = WF.TextBox()
pattern_tb.Location = SD.Point(84, 56)
pattern_tb.Size = SD.Size(436, 24)
go.Controls.Add(pattern_tb)

label(go, 'Parameter', 12, 90, 70)
param_combo = combo(go, sheet_param_names(sheets), 84, 90, 260)
btn_insert = button(go, 'Insert', 350, 89, 70)
btn_reset = button(go, 'Default', 426, 89, 94)
preview_lbl = label(go, '', 12, 126, 508, 22)
preview_lbl.ForeColor = SD.Color.DimGray


def update_preview(*args):
    first = None
    for s in sheets:
        if checked[s.SheetNumber]:
            first = s
            break
    if first is None and sheets:
        first = sheets[0]
    if first is None:
        preview_lbl.Text = 'No sheets in this model.'
        return
    preview_lbl.Text = 'Example: ' + build_name(first, pattern_tb.Text) + '.pdf / .dwg'


def on_browse(sender, e):
    d = WF.FolderBrowserDialog()
    d.Description = 'Choose the export folder'
    if os.path.isdir(folder_tb.Text):
        d.SelectedPath = folder_tb.Text
    if d.ShowDialog() == WF.DialogResult.OK:
        folder_tb.Text = d.SelectedPath


def on_insert(sender, e):
    if param_combo.SelectedItem is None:
        return
    token = '{' + param_combo.SelectedItem + '}'
    pos = pattern_tb.SelectionStart
    pattern_tb.Text = pattern_tb.Text[:pos] + token + pattern_tb.Text[pos + pattern_tb.SelectionLength:]
    pattern_tb.SelectionStart = pos + len(token)
    pattern_tb.Focus()


btn_browse.Click += on_browse
btn_insert.Click += on_insert
btn_reset.Click += lambda s, e: setattr(pattern_tb, 'Text', DEFAULTS['pattern'])
pattern_tb.TextChanged += update_preview

# ---- Bottom buttons -------------------------------------------------------
btn_export = button(form, 'Export', 812, 650, 86, 30)
btn_cancel = button(form, 'Cancel', 904, 650, 86, 30)
btn_cancel.DialogResult = WF.DialogResult.Cancel
form.CancelButton = btn_cancel


def on_export(sender, e):
    nums = [s.SheetNumber for s in sheets if checked[s.SheetNumber]]
    if not nums:
        msg('Select at least one sheet.', WF.MessageBoxIcon.Warning)
        return
    if not chk_pdf.Checked and not chk_dwg.Checked:
        msg('Tick PDF, DWG or both.', WF.MessageBoxIcon.Warning)
        return
    folder = folder_tb.Text.strip()
    if not folder:
        msg('Choose an output folder.', WF.MessageBoxIcon.Warning)
        return
    if not pattern_tb.Text.strip():
        msg('Enter a file name pattern.', WF.MessageBoxIcon.Warning)
        return
    names = [build_name(sheet_by_num[n], pattern_tb.Text) for n in nums]
    dupes = sorted(set(x for x in names if names.count(x) > 1))
    if dupes:
        if msg('These file names repeat, so later sheets would overwrite earlier ones:\n\n' +
               '\n'.join(dupes[:10]) + '\n\nExport anyway?',
               WF.MessageBoxIcon.Warning, WF.MessageBoxButtons.YesNo) != WF.DialogResult.Yes:
            return
    state['result'] = {
        'sheets': nums,
        'folder': folder,
        'pattern': pattern_tb.Text,
        'export_pdf': chk_pdf.Checked,
        'export_dwg': chk_dwg.Checked,
        'dwg_setup': dwg_setup.SelectedItem if dwg_setup.SelectedIndex > 0 else '',
        'pdf': read_pdf_controls(),
    }
    form.DialogResult = WF.DialogResult.OK
    form.Close()


btn_export.Click += on_export

# ---- Initial values -------------------------------------------------------
chk_pdf.Checked = bool(settings['export_pdf'])
chk_dwg.Checked = bool(settings['export_dwg'])
fill_pdf(settings)
pdf_setup.SelectedIndex = 0
set_combo(dwg_setup, settings['dwg_setup'] or '<default settings>')
dwg_setup.Enabled = chk_dwg.Checked
folder_tb.Text = settings['folder']
pattern_tb.Text = settings['pattern']
if param_combo.Items.Count > 0:
    param_combo.SelectedIndex = 0
reload_sets()
refresh_list()

form.ResumeLayout(False)

# --------------------------------------------------------------------------
# Export
# --------------------------------------------------------------------------
def make_pdf_options(p):
    o = PDFExportOptions()
    o.Combine = True        # one sheet per call, so FileName controls the name
    o.PaperFormat = enum_value(ExportPaperFormat, p['paper_format'])
    if p['paper_format'] != 'Default':
        o.PaperOrientation = enum_value(PageOrientationType, p['orientation'])
    o.PaperPlacement = enum_value(PaperPlacementType, p['placement'])
    if p['placement'] == 'LowerLeft':
        o.OriginOffsetX = p['offset_x'] / 304.8   # mm -> feet
        o.OriginOffsetY = p['offset_y'] / 304.8
    if p['zoom_fit']:
        o.ZoomType = ZoomType.FitToPage
    else:
        o.ZoomType = ZoomType.Zoom
        o.ZoomPercentage = int(p['zoom_pct'])
    o.AlwaysUseRaster = p['raster_hidden']
    o.RasterQuality = enum_value(RasterQualityType, p['raster_quality'])
    o.ColorDepth = enum_value(ColorDepthType, p['color_depth'])
    set_links_blue(o, p['links_blue'])
    o.HideReferencePlane = p['hide_ref']
    o.HideUnreferencedViewTags = p['hide_tags']
    o.HideScopeBoxes = p['hide_scope']
    o.HideCropBoundaries = p['hide_crop']
    o.ReplaceHalftoneWithThinLines = p['halftone_thin']
    o.MaskCoincidentLines = p['mask_lines']
    return o


def make_dwg_options(setup):
    o = None
    if setup:
        try:
            o = DWGExportOptions.GetPredefinedOptions(doc, setup)
        except Exception:
            o = None
    if o is None:
        o = DWGExportOptions()
    o.MergedViews = True    # no xrefs: views are bound into the sheet's DWG
    return o


report = []
try:
    form_result = form.ShowDialog()
except Exception:
    form_result = None
    report.append('Dialog error:\n' + traceback.format_exc())

res = state['result']
if form_result == WF.DialogResult.OK and res:
    # remember everything for next time
    settings.update(res['pdf'])
    settings['folder'] = res['folder']
    settings['pattern'] = res['pattern']
    settings['export_pdf'] = res['export_pdf']
    settings['export_dwg'] = res['export_dwg']
    settings['dwg_setup'] = res['dwg_setup']
    settings.pop('selection', None)
    save_settings(settings)

    folder = res['folder']
    if not os.path.isdir(folder):
        os.makedirs(folder)

    # exports cannot run while Dynamo holds a transaction open
    try:
        TransactionManager.Instance.ForceCloseTransaction()
    except Exception:
        pass

    pdf_opts = make_pdf_options(res['pdf']) if res['export_pdf'] else None
    dwg_opts = make_dwg_options(res['dwg_setup']) if res['export_dwg'] else None

    ok_pdf, ok_dwg, errors, created = 0, 0, [], []
    n = len(res['sheets'])
    steps = n * ((1 if pdf_opts is not None else 0) + (1 if dwg_opts is not None else 0))
    cancel = {'requested': False}

    # progress window (modeless, kept alive with DoEvents between files)
    pf = WF.Form()
    pf.Text = 'Sheet Exporter - exporting'
    pf.Font = FONT
    pf.FormBorderStyle = WF.FormBorderStyle.FixedDialog
    pf.StartPosition = WF.FormStartPosition.CenterScreen
    pf.MinimizeBox = False
    pf.MaximizeBox = False
    pf.TopMost = True
    pf.ClientSize = SD.Size(460, 120)
    p_lbl = label(pf, 'Starting...', 12, 10, 436, 22)
    p_bar = WF.ProgressBar()
    p_bar.Location = SD.Point(12, 40)
    p_bar.Size = SD.Size(436, 22)
    p_bar.Minimum = 0
    p_bar.Maximum = max(1, steps)
    pf.Controls.Add(p_bar)
    p_cancel = button(pf, 'Cancel', 362, 78, 86, 30)

    def request_cancel(*args):
        cancel['requested'] = True
        p_cancel.Enabled = False
        p_lbl.Text = 'Cancelling after the current file...'

    def on_progress_closing(sender, e):
        if not cancel.get('done'):
            e.Cancel = True
            request_cancel()

    p_cancel.Click += request_cancel
    pf.FormClosing += on_progress_closing
    pf.Show()
    WF.Application.DoEvents()

    t_start = System.DateTime.Now
    step = 0

    def tick(text):
        p_lbl.Text = text
        p_bar.Value = min(step, p_bar.Maximum)
        WF.Application.DoEvents()

    for i, num in enumerate(res['sheets']):
        if cancel['requested']:
            break
        sheet = sheet_by_num[num]
        name = build_name(sheet, res['pattern'])
        ids = List[ElementId]()
        ids.Add(sheet.Id)
        if pdf_opts is not None and not cancel['requested']:
            tick('Sheet %d of %d  -  PDF  -  %s' % (i + 1, n, name))
            try:
                pdf_opts.FileName = name
                if doc.Export(folder, ids, pdf_opts):
                    ok_pdf += 1
                    created.append(os.path.join(folder, name + '.pdf'))
                else:
                    errors.append('PDF  %s: Revit reported a failure' % num)
            except Exception as ex:
                errors.append('PDF  %s: %s' % (num, ex))
            step += 1
        if dwg_opts is not None and not cancel['requested']:
            tick('Sheet %d of %d  -  DWG  -  %s' % (i + 1, n, name))
            try:
                if doc.Export(folder, name, ids, dwg_opts):
                    ok_dwg += 1
                    created.append(os.path.join(folder, name + '.dwg'))
                else:
                    errors.append('DWG  %s: Revit reported a failure' % num)
            except Exception as ex:
                errors.append('DWG  %s: %s' % (num, ex))
            step += 1
        tick(p_lbl.Text)

    t_end = System.DateTime.Now
    cancel['done'] = True
    pf.Close()

    deleted = 0
    if cancel['requested'] and created:
        if msg('Export cancelled. %d file(s) were exported before you cancelled.\n\n'
               'Delete them too?' % len(created),
               WF.MessageBoxIcon.Question, WF.MessageBoxButtons.YesNo) == WF.DialogResult.Yes:
            for f in created:
                try:
                    if os.path.isfile(f):
                        os.remove(f)
                        deleted += 1
                except Exception as ex:
                    errors.append('Could not delete %s: %s' % (f, ex))

    dur = t_end.Subtract(t_start)   # .NET DateTime has no Python '-' in CPython3
    dur_txt = '%d:%02d:%02d' % (int(dur.TotalHours), dur.Minutes, dur.Seconds)
    if cancel['requested']:
        summary = 'Export CANCELLED  -  %s\n' % folder
    else:
        summary = 'Exported to %s\n' % folder
    summary += '\nStarted:   %s\nFinished:  %s\nDuration:  %s\n\n' % (
        t_start.ToString('yyyy-MM-dd HH:mm:ss'), t_end.ToString('yyyy-MM-dd HH:mm:ss'), dur_txt)
    if pdf_opts is not None:
        summary += 'PDF: %d of %d\n' % (ok_pdf, n)
    if dwg_opts is not None:
        summary += 'DWG: %d of %d\n' % (ok_dwg, n)
    if deleted:
        summary += 'Deleted after cancel: %d file(s)\n' % deleted
    if errors:
        summary += '\nProblems:\n' + '\n'.join(errors[:20])
        if len(errors) > 20:
            summary += '\n... and %d more' % (len(errors) - 20)
    report.append(summary)
    msg(summary)
elif not report:
    report.append('Cancelled.')

OUT = '\n'.join(report)
# ----------------------------------------
