# Dynamo graph Smart-Dimensions.dyn "SmartDimensions" (Dynamo 3.0.3.7597)
# Places chained dimensions of a chosen type along path lines of a chosen line style in the active plan view, referencing the ticked categories and types (grids, walls with openings, families, floors...).

run = BoolSelector(true)
smart_dimensions = Python(IN[0]=run)  # CPython3; graph output
# ---------- smart_dimensions.python (1463 lines) ----------
# -*- coding: utf-8 -*-
"""
Smart Dimensions for plans (Dynamo Player, Revit 2025+). Built for masonry plans,
works with any model category.

Workflow
  1. Draw detail lines in the plan view with a dedicated line style
     (for example "DIM-PATH" for detailed strings, "DIM-PATH-OVERALL" for overall strings).
     Each line is where one dimension string will run. Draw it from grid to grid.
  2. Run the graph from Dynamo Player. A dialog asks for the dimension type, the path
     line styles, and in a category > type tree which types to dimension (Dimension tab)
     and which to use as fixed anchors (Reference tab).
  3. For every path line the script collects, in order along the line, per element kind:
       - line   (grids, reference planes): where the line crosses them,
       - wall   both faces of walls the line crosses; end faces and opening jambs of
                walls parallel to the line within the search distance,
       - family (columns, beams, doors, equipment...): first and last face along the
                line, if the family lies within the search distance,
       - host   (floors, roofs, foundations...): faces the line crosses,
     merges coincident references and places one chained dimension on the line.
  4. Segments between the two jambs of one opening get the opening height
     (and the sill height for windows) as text below the value.

The pure logic (classification, merging, overall filter, opening detection) has no
Revit dependency so it can be tested outside Revit.
"""

import os
import json
import math
import traceback

# ---------------------------------------------------------------------------
# Constants (Revit internal units are feet)
# ---------------------------------------------------------------------------
FT_PER_CM = 1.0 / 30.48
MERGE_TOL = 0.5 / 304.8          # 0.5 mm: references closer than this are merged
LATERAL_TOL = 1.0 / 304.8        # 1 mm: tolerance for "the path crosses this face"
PERP_DOT = 0.05                  # |cos| below this = wall perpendicular to the path
PAR_DOT = 0.995                  # |cos| above this = wall parallel to the path
FACE_PAR_DOT = 0.9999            # face normal must be this parallel to the path
Z_TOL = 1.0 / 304.8              # 1 mm vertical tolerance
SMALL_SEGMENT = 5.0 * FT_PER_CM
GRID_END_TOL = 10.0 * FT_PER_CM  # a grid up to 10 cm past a path end still counts  # segments under 5 cm are reported (text overlap)

PRIO_GRID = 4
PRIO_REF_FACE = 3
PRIO_HOST_FACE = 2
PRIO_LINK_FACE = 1

DEFAULT_SETTINGS = {
    "dimension_type": "",
    "detail_style": "",
    "overall_style": "",
    "dim_types": [],
    "ref_types": [],
    "search_distance_cm": 90.0,
    "replace_existing": True,
    "debug": False,
    "opening_text": True,
    "height_prefix": "h=",
    "sill_prefix": "bk=",
}


# ---------------------------------------------------------------------------
# Pure logic (no Revit)
# ---------------------------------------------------------------------------
def dot2(a, b):
    return a[0] * b[0] + a[1] * b[1]


def classify_wall(wall_dir, path_dir):
    """'perp' when the wall crosses the path, 'par' when it runs alongside, else None."""
    c = abs(dot2(wall_dir, path_dir))
    if c < PERP_DOT:
        return "perp"
    if c > PAR_DOT:
        return "par"
    return None


def face_hit(face, path_p0, path_dir, path_len, wall_kind, search_dist):
    """
    Decide if a vertical planar face is a witness line target for the path.

    face: dict with n (2D unit normal), c (plane offset: dot(n, X) = c),
          umin/umax (extent along the horizontal tangent u = (-ny, nx)).
    Returns (t, normal_sign) or None. t = distance along the path.
    """
    n = face["n"]
    nd = dot2(n, path_dir)
    if abs(nd) < FACE_PAR_DOT:
        return None
    t = (face["c"] - dot2(n, path_p0)) / nd
    if t < -MERGE_TOL or t > path_len + MERGE_TOL:
        return None
    u = (-n[1], n[0])
    s = dot2(u, path_p0)
    umin, umax = face["umin"], face["umax"]
    if wall_kind == "perp":
        if not (umin - LATERAL_TOL <= s <= umax + LATERAL_TOL):
            return None
    elif wall_kind in ("par", "near"):
        dist = max(umin - s, s - umax, 0.0)
        if dist > search_dist:
            return None
    else:
        return None
    return t, (1 if nd > 0 else -1)


def grid_hit(g0, gdir, path_p0, path_dir, path_len):
    """Distance along the path where it crosses the (unbounded) grid line, or None."""
    cross = path_dir[0] * gdir[1] - path_dir[1] * gdir[0]
    if abs(cross) < PERP_DOT:
        return None
    wx, wy = g0[0] - path_p0[0], g0[1] - path_p0[1]
    t = (wx * gdir[1] - wy * gdir[0]) / cross
    if t < -GRID_END_TOL or t > path_len + GRID_END_TOL:
        return None
    return t


def merge_candidates(cands, tol=MERGE_TOL):
    """
    cands: list of dicts {t, ref, prio, meta}. Sort along the path and merge
    references closer than tol. The highest priority reference represents the
    cluster; all metas are kept (needed for opening detection).
    """
    out = []
    for c in sorted(cands, key=lambda x: x["t"]):
        if out and abs(c["t"] - out[-1]["t_last"]) <= tol:
            cl = out[-1]
            cl["metas"].append(c["meta"])
            cl["t_last"] = c["t"]
            if c["prio"] > cl["prio"]:
                cl["prio"], cl["ref"], cl["t"] = c["prio"], c["ref"], c["t"]
        else:
            out.append({"t": c["t"], "t_last": c["t"], "ref": c["ref"],
                        "prio": c["prio"], "metas": [c["meta"]]})
    return out


def is_grid_cluster(cl):
    return any(m.get("kind") == "grid" for m in cl["metas"])


def is_anchor_cluster(cl):
    """Grids and faces of reference (structural) walls are fixed anchors of a string."""
    return any(m.get("kind") == "grid" or m.get("role") == "reference" for m in cl["metas"])


def is_opening_jamb_only(cl):
    """True when every reference in the cluster is a jamb of an opening (partial height)."""
    return all(m.get("kind") == "face" and m.get("wall_kind") == "par" and m.get("partial")
               for m in cl["metas"])


def overall_filter(clusters):
    """Keep anchors (grids, reference walls), and per interval between anchors only the
    first and last masonry face. Opening jambs are ignored: an overall string measures
    the walls, not the openings."""
    keep = []
    group = []

    def flush():
        if group:
            keep.append(group[0])
            if len(group) > 1:
                keep.append(group[-1])
        del group[:]

    for cl in clusters:
        if is_anchor_cluster(cl):
            flush()
            keep.append(cl)
        elif not is_opening_jamb_only(cl):
            group.append(cl)
    flush()
    return keep


def find_openings(clusters, floor_z):
    """
    Segment i (between cluster i and i+1) is an opening when cluster i holds a jamb
    face of a parallel wall whose normal points forward (+1) and cluster i+1 a jamb
    face of the same wall pointing back (-1), both with the same vertical extent and
    lower than the wall itself. Returns {segment_index: (height, sill)}.
    """
    res = {}
    for i in range(len(clusters) - 1):
        found = None
        for a in clusters[i]["metas"]:
            if not (a.get("kind") == "face" and a.get("wall_kind") == "par"
                    and a.get("sign") == 1 and a.get("partial")
                    and a.get("role", "dimension") == "dimension"):
                continue
            for b in clusters[i + 1]["metas"]:
                if (b.get("kind") == "face" and b.get("wall_kind") == "par"
                        and b.get("sign") == -1 and b.get("partial")
                        and b.get("wall") == a.get("wall")
                        and abs(b["zmin"] - a["zmin"]) < Z_TOL
                        and abs(b["zmax"] - a["zmax"]) < Z_TOL):
                    found = (a["zmax"] - a["zmin"], a["zmin"] - floor_z, a)
                    break
            if found:
                break
        if found:
            res[i] = found
    return res


def opening_text(height_txt, sill_txt, height_prefix, sill_prefix, has_sill):
    parts = []
    if height_prefix is not None:
        parts.append(u"{0}{1}".format(height_prefix, height_txt))
    if has_sill and sill_prefix:
        parts.append(u"{0}{1}".format(sill_prefix, sill_txt))
    return u" ".join(parts)


def make_labels(raw_keys):
    """
    raw_keys: iterable of (link_title_or_None, family_name, type_name).
    Label = type name; "[link] " in front for linked walls; " (family)" behind only when
    the same type name exists in more than one family. Returns {raw_key: label}.
    """
    fams = {}
    for link, fam, typ in raw_keys:
        fams.setdefault((link, typ), set()).add(fam)
    out = {}
    for k in set(raw_keys):
        link, fam, typ = k
        lab = typ
        if len(fams[(link, typ)]) > 1 and fam:
            lab = u"{0} ({1})".format(typ, fam)
        if link:
            lab = u"[{0}] {1}".format(link, lab)
        out[k] = lab
    return out


def type_key(category, label):
    return u"{0}|{1}".format(category, label)


def filter_labels(labels, query, prefix=u""):
    """Case-insensitive search; every word of the query must appear in prefix + label."""
    words = [w for w in (query or u"").lower().split() if w]
    if not words:
        return list(labels)
    return [l for l in labels if all(w in (prefix + u" " + l).lower() for w in words)]


def settings_path():
    base = os.environ.get("APPDATA") or os.path.expanduser("~")
    return os.path.join(base, "SmartDimensions", "settings.json")


def load_settings():
    s = dict(DEFAULT_SETTINGS)
    try:
        with open(settings_path(), "r") as f:
            s.update(json.load(f))
    except Exception:
        pass
    return s


def save_settings(s):
    try:
        p = settings_path()
        if not os.path.isdir(os.path.dirname(p)):
            os.makedirs(os.path.dirname(p))
        with open(p, "w") as f:
            json.dump(s, f, indent=2)
    except Exception:
        pass


# ---------------------------------------------------------------------------
# Revit / Dynamo part
# ---------------------------------------------------------------------------
REVIT = True
try:
    import clr
    clr.AddReference("RevitAPI")
    clr.AddReference("RevitServices")
    clr.AddReference("System.Windows.Forms")
    clr.AddReference("System.Drawing")
    from Autodesk.Revit import DB
    from RevitServices.Persistence import DocumentManager
    from RevitServices.Transactions import TransactionManager
    import System.Windows.Forms as WF
    import System.Drawing as SD
except Exception:
    REVIT = False


def eid_int(eid):
    """ElementId as int; .Value from Revit 2024, .IntegerValue before (removed in 2026)."""
    try:
        return int(eid.Value)
    except Exception:
        return int(eid.IntegerValue)


def tname(obj):
    try:
        return obj.GetType().Name
    except Exception:
        return ""


def el_name(e):
    try:
        n = e.Name
        if n:
            return n
    except Exception:
        pass
    try:
        return DB.Element.Name.GetValue(e)
    except Exception:
        pass
    try:
        return e.get_Parameter(DB.BuiltInParameter.SYMBOL_NAME_PARAM).AsString()
    except Exception:
        return ""


def unit2(x, y):
    l = math.hypot(x, y)
    if l < 1e-12:
        return None
    return (x / l, y / l)


def bbox_z(elem, view=None, transform=None):
    bb = elem.get_BoundingBox(view)
    if bb is None:
        return None
    zs = []
    for p in (bb.Min, bb.Max):
        q = transform.OfPoint(p) if transform is not None else p
        zs.append(q.Z)
    return min(zs), max(zs)


def cut_plane_z(doc, view, floor_z):
    """Absolute z of the view's cut plane, based on the z of the path lines."""
    try:
        vr = view.GetViewRange()
        off = vr.GetOffset(DB.PlanViewPlane.CutPlane)
        lvl = doc.GetElement(vr.GetLevelId(DB.PlanViewPlane.CutPlane))
        gen = view.GenLevel
        delta = 0.0
        if lvl is not None and gen is not None:
            delta = lvl.Elevation - gen.Elevation
        return floor_z + delta + off
    except Exception:
        return floor_z + 1200.0 / 304.8


def collect_dimension_types(doc):
    res = {}
    for dt in DB.FilteredElementCollector(doc).OfClass(DB.DimensionType):
        try:
            if dt.StyleType != DB.DimensionStyleType.Linear:
                continue
        except Exception:
            continue
        n = el_name(dt)
        if n and n not in res:
            res[n] = dt
    return res


def collect_line_styles(doc):
    res = {}
    cat = doc.Settings.Categories.get_Item(DB.BuiltInCategory.OST_Lines)
    for sc in cat.SubCategories:
        gs = sc.GetGraphicsStyle(DB.GraphicsStyleType.Projection)
        if gs is not None:
            res[sc.Name] = gs.Id
    return res


def link_instances(doc, view):
    out = []
    for li in DB.FilteredElementCollector(doc, view.Id).OfClass(DB.RevitLinkInstance):
        ldoc = li.GetLinkDocument()
        if ldoc is not None:
            out.append((li, ldoc))
    return out


def collect_paths(doc, view, style_ids):
    """Straight detail/model lines in the view whose line style is one of style_ids."""
    paths = []
    skipped = 0
    for ce in DB.FilteredElementCollector(doc, view.Id).OfClass(DB.CurveElement):
        try:
            ls = ce.LineStyle
        except Exception:
            continue
        if ls is None:
            continue
        sid = eid_int(ls.Id)
        if sid not in style_ids:
            continue
        crv = ce.GeometryCurve
        if tname(crv) != "Line":
            skipped += 1
            continue
        a, b = crv.GetEndPoint(0), crv.GetEndPoint(1)
        d = unit2(b.X - a.X, b.Y - a.Y)
        if d is None:
            continue
        paths.append({"elem": ce, "a": a, "b": b, "p0": (a.X, a.Y), "dir": d,
                      "len": math.hypot(b.X - a.X, b.Y - a.Y), "mode": style_ids[sid]})
    return paths, skipped


def delete_dims_on_paths(doc, view, paths):
    """Delete dimensions whose line lies on one of the path lines (a previous run)."""
    ids = {}
    for dim in DB.FilteredElementCollector(doc, view.Id).OfClass(DB.Dimension):
        try:
            crv = dim.Curve
            if crv is None or tname(crv) != "Line":
                continue
            dd = crv.Direction
            org = crv.Origin
            dorg = dim.Origin
        except Exception:
            continue
        for p in paths:
            d = p["dir"]
            if abs(d[0] * dd.Y - d[1] * dd.X) > 1e-6:
                continue
            vx, vy = org.X - p["p0"][0], org.Y - p["p0"][1]
            if abs(vx * d[1] - vy * d[0]) > 1e-4:
                continue
            t = (dorg.X - p["p0"][0]) * d[0] + (dorg.Y - p["p0"][1]) * d[1]
            if -MERGE_TOL <= t <= p["len"] + MERGE_TOL:
                ids[eid_int(dim.Id)] = dim.Id
                break
    n = 0
    for i in ids.values():
        try:
            doc.Delete(i)
            n += 1
        except Exception:
            pass
    return n


def bic_ints(names):
    out = set()
    for n in names:
        try:
            out.add(int(getattr(DB.BuiltInCategory, n)))
        except Exception:
            pass
    return out


# Categories that give line references (unbounded vertical planes seen as lines in plan).
LINE_CATEGORIES = ["OST_Grids", "OST_CLines"]
# Model categories that make no sense as dimension targets.
EXCLUDED_CATEGORIES = [
    "OST_Rooms", "OST_Areas", "OST_MEPSpaces", "OST_Lines", "OST_RvtLinks", "OST_Cameras",
    "OST_IOSModelGroups", "OST_SketchLines", "OST_RoomSeparationLines", "OST_AreaSchemeLines",
    "OST_MEPSpaceSeparationLines", "OST_SectionBox", "OST_VolumeOfInterest", "OST_PointClouds",
    "OST_DetailComponents", "OST_Entourage", "OST_Planting", "OST_Topography", "OST_Toposolid",
    "OST_Site", "OST_Parking", "OST_RoomTags", "OST_Viewers", "OST_Levels",
    "OST_ProjectBasePoint", "OST_SharedBasePoint", "OST_InternalOriginSurveyPoint",
]


def element_kind(e):
    """
    line   grids, reference planes: one line reference
    wall   walls: faces, ends, openings (perpendicular / parallel rules)
    family loadable families (columns, beams, doors, equipment): outer faces only
    host   other model elements (floors, roofs, foundations, ...): faces the line crosses
    """
    n = tname(e)
    if n in ("Grid", "ReferencePlane"):
        return "line"
    if n == "Wall":
        return "wall"
    if n == "FamilyInstance":
        return "family"
    return "host"


def type_raw_key(e, edoc, link_title):
    """(link, family, type label) used for the label in the selector."""
    if tname(e) == "ReferencePlane":
        n = e.Name
        return (link_title, "", n if n else "(unnamed reference planes)")
    t = None
    try:
        tid = e.GetTypeId()
        if tid is not None and eid_int(tid) > 0:
            t = edoc.GetElement(tid)
    except Exception:
        t = None
    if t is None:
        return (link_title, "", "(no type)")
    fam = ""
    try:
        fam = t.FamilyName or ""
    except Exception:
        pass
    if tname(t) == "FamilySymbol":
        # Loadable family types: "Family : Type" (type names alone are ambiguous).
        return (link_title, "", u"{0} : {1}".format(fam, el_name(t)) if fam else el_name(t))
    return (link_title, fam, el_name(t))


class Picker(object):
    """Decides which elements of a document can appear in the selector."""

    def __init__(self):
        self.line_cats = bic_ints(LINE_CATEGORIES)
        self.excluded = bic_ints(EXCLUDED_CATEGORIES)

    def accept(self, e):
        try:
            cat = e.Category
        except Exception:
            return None
        if cat is None:
            return None
        cid = eid_int(cat.Id)
        if cid in self.line_cats:
            return cat.Name
        if cid in self.excluded or cid > 0:
            return None
        if cat.Name.startswith("<"):
            return None
        try:
            if cat.CategoryType != DB.CategoryType.Model:
                return None
        except Exception:
            return None
        # Nested shared components are dimensioned through their parent.
        try:
            if e.SuperComponent is not None:
                return None
        except Exception:
            pass
        return cat.Name


def view_outline_for_link(view, inv_tf, zr):
    """Outline (in link coordinates) of the crop box + view z range, or None for no XY limit."""
    pts = []
    big = 1.0e5
    try:
        if view.CropBoxActive:
            cb = view.CropBox
            for x in (cb.Min.X, cb.Max.X):
                for y in (cb.Min.Y, cb.Max.Y):
                    pts.append(cb.Transform.OfPoint(DB.XYZ(x, y, 0)))
    except Exception:
        pts = []
    if not pts:
        pts = [DB.XYZ(-big, -big, 0), DB.XYZ(big, big, 0)]
    corners = []
    for p in pts:
        for z in zr:
            corners.append(inv_tf.OfPoint(DB.XYZ(p.X, p.Y, z)))
    mn = DB.XYZ(min(c.X for c in corners), min(c.Y for c in corners), min(c.Z for c in corners))
    mx = DB.XYZ(max(c.X for c in corners), max(c.Y for c in corners), max(c.Z for c in corners))
    return DB.Outline(mn, mx)


def view_z_range(doc, view, floor_z):
    """(bottom, top) of the view range in model z, relative to the given floor z."""
    def plane_z(plane, default):
        try:
            vr = view.GetViewRange()
            lid = vr.GetLevelId(plane)
            if lid is None or eid_int(lid) < 0:
                return default
            lvl = doc.GetElement(lid)
            gen = view.GenLevel
            return floor_z + (lvl.Elevation - gen.Elevation) + vr.GetOffset(plane)
        except Exception:
            return default
    bottom = plane_z(DB.PlanViewPlane.ViewDepthPlane, floor_z - 3.0)
    top = plane_z(DB.PlanViewPlane.TopClipPlane, floor_z + 15.0)
    return min(bottom, top), max(bottom, top)


def collect_entries(doc, view, floor_guess):
    """
    Every selectable element in the view, host and linked.
    Returns list of dicts {cat, label, elem, edoc, li, tf, kind}.
    """
    picker = Picker()
    raw = []
    for e in DB.FilteredElementCollector(doc, view.Id).WhereElementIsNotElementType():
        cat = picker.accept(e)
        if cat is None:
            continue
        raw.append((cat, type_raw_key(e, doc, None), e, doc, None, None))
    zr = view_z_range(doc, view, floor_guess)
    for li, ldoc in link_instances(doc, view):
        tf = li.GetTotalTransform()
        title = ldoc.Title
        col = DB.FilteredElementCollector(ldoc).WhereElementIsNotElementType()
        try:
            col = col.WherePasses(DB.BoundingBoxIntersectsFilter(view_outline_for_link(view, tf.Inverse, zr)))
        except Exception:
            pass
        for e in col:
            cat = picker.accept(e)
            if cat is None:
                continue
            raw.append((cat, type_raw_key(e, ldoc, title), e, ldoc, li, tf))
    labels = {}
    by_cat = {}
    for cat, k, _, _, _, _ in raw:
        by_cat.setdefault(cat, []).append(k)
    for cat, keys in by_cat.items():
        lab = make_labels(keys)
        for k, v in lab.items():
            labels[(cat, k)] = v
    return [{"cat": cat, "label": labels[(cat, k)], "elem": e, "edoc": ed, "li": li, "tf": tf,
             "kind": element_kind(e)} for cat, k, e, ed, li, tf in raw]


def iter_solids(geom):
    for g in geom:
        n = tname(g)
        if n == "Solid":
            try:
                if g.Volume > 0 and g.Faces.Size > 0:
                    yield g
            except Exception:
                pass
        elif n == "GeometryInstance":
            for s in iter_solids(g.GetInstanceGeometry()):
                yield s


def compose(a, b):
    """Transform a applied after b (either may be None)."""
    if a is None:
        return b
    if b is None:
        return a
    return a.Multiply(b)


def face_record(face, xf, ref):
    """Vertical planar face -> dict, or (None, zmin, zmax) info for non-vertical faces."""
    bb = face.GetBoundingBox()
    nrm = face.ComputeNormal(DB.UV((bb.Min.U + bb.Max.U) / 2.0, (bb.Min.V + bb.Max.V) / 2.0))
    if xf is not None:
        nrm = xf.OfVector(nrm)
    pts = []
    for loop in face.EdgeLoops:
        for edge in loop:
            for p in edge.Tessellate():
                pts.append(xf.OfPoint(p) if xf is not None else p)
    if not pts:
        return None, None, None
    fz0 = min(p.Z for p in pts)
    fz1 = max(p.Z for p in pts)
    if abs(nrm.Z) > 0.01:
        return None, fz0, fz1
    n2 = unit2(nrm.X, nrm.Y)
    if n2 is None:
        return None, fz0, fz1
    u = (-n2[1], n2[0])
    us = [u[0] * p.X + u[1] * p.Y for p in pts]
    xs = [p.X for p in pts]
    ys = [p.Y for p in pts]
    return ({"n": n2, "c": n2[0] * pts[0].X + n2[1] * pts[0].Y,
             "umin": min(us), "umax": max(us), "zmin": fz0, "zmax": fz1, "ref": ref,
             "xy": (min(xs), min(ys), max(xs), max(ys))}, fz0, fz1)


def element_faces(entry, opts, warnings):
    """
    Vertical planar faces of an element with references usable in a dimension.
    Family instance geometry comes as symbol geometry; its references are rebuilt as
    instance references through their stable representation.
    """
    e, edoc, li, tf = entry["elem"], entry["edoc"], entry["li"], entry["tf"]
    geom = e.get_Geometry(opts)
    if geom is None:
        return [], None, None
    faces = []
    zmin, zmax = 1e9, -1e9

    def add(face, xf, ref):
        rec, z0, z1 = face_record(face, xf, ref)
        if z0 is not None:
            zs[0] = min(zs[0], z0)
            zs[1] = max(zs[1], z1)
        if rec is None or ref is None:
            return
        if li is not None:
            try:
                rec["ref"] = ref.CreateLinkReference(li)
            except Exception:
                warnings["linkref"] = warnings.get("linkref", 0) + 1
                return
        faces.append(rec)

    zs = [zmin, zmax]
    for g in geom:
        n = tname(g)
        if n == "Solid":
            try:
                if g.Volume <= 0:
                    continue
            except Exception:
                continue
            for face in g.Faces:
                if tname(face) == "PlanarFace":
                    add(face, tf, face.Reference)
        elif n == "GeometryInstance":
            xf = compose(tf, g.Transform)
            for sg in g.GetSymbolGeometry():
                if tname(sg) != "Solid":
                    continue
                try:
                    if sg.Volume <= 0:
                        continue
                except Exception:
                    continue
                for face in sg.Faces:
                    if tname(face) != "PlanarFace" or face.Reference is None:
                        continue
                    ref = None
                    try:
                        stable = face.Reference.ConvertToStableRepresentation(edoc)
                        ref = DB.Reference.ParseFromStableRepresentation(
                            edoc, u"{0}:0:INSTANCE:{1}".format(e.UniqueId, stable))
                    except Exception:
                        warnings["instref"] = warnings.get("instref", 0) + 1
                    add(face, xf, ref)
    return faces, zs[0], zs[1]


def line_record(entry):
    e, li, tf = entry["elem"], entry["li"], entry["tf"]
    if tname(e) == "Grid":
        crv = e.Curve
        if tname(crv) != "Line":
            return None
        a, b = crv.GetEndPoint(0), crv.GetEndPoint(1)
        ref = DB.Reference(e)
    else:
        try:
            if abs(e.Normal.Z) > 0.01:
                return None
        except Exception:
            return None
        a, b = e.BubbleEnd, e.FreeEnd
        ref = e.GetReference()
    if tf is not None:
        a, b = tf.OfPoint(a), tf.OfPoint(b)
    d = unit2(b.X - a.X, b.Y - a.Y)
    if d is None or ref is None:
        return None
    if li is not None:
        try:
            ref = ref.CreateLinkReference(li)
        except Exception:
            return None
    return {"type": "line", "p0": (a.X, a.Y), "dir": d, "ref": ref, "role": entry["role"],
            "linked": li is not None}


def bbox_xy(entry):
    bb = entry["elem"].get_BoundingBox(None)
    if bb is None:
        return None
    tf = entry["tf"]
    pts = []
    for x in (bb.Min.X, bb.Max.X):
        for y in (bb.Min.Y, bb.Max.Y):
            p = DB.XYZ(x, y, bb.Min.Z)
            pts.append(tf.OfPoint(p) if tf is not None else p)
    return (min(p.X for p in pts), min(p.Y for p in pts), max(p.X for p in pts), max(p.Y for p in pts))


def rects_overlap(a, b):
    return not (a[2] < b[0] or b[2] < a[0] or a[3] < b[1] or b[3] < a[1])


def path_rect(p, margin):
    xs = (p["a"].X, p["b"].X)
    ys = (p["a"].Y, p["b"].Y)
    return (min(xs) - margin, min(ys) - margin, max(xs) + margin, max(ys) + margin)


def build_records(entries, view, paths, cut_z, zr, sdist, warnings):
    """Geometry records for the ticked elements that lie near at least one path line."""
    opts_host = DB.Options()
    opts_host.ComputeReferences = True
    # No view here: view-specific geometry of a plan is clipped at the cut plane, which
    # made opening heights run from the sill to the cut plane only.
    opts_host.DetailLevel = view.DetailLevel
    opts_link = DB.Options()
    opts_link.ComputeReferences = True
    opts_link.DetailLevel = view.DetailLevel
    rects = [path_rect(p, sdist + 1.0) for p in paths]
    recs = []
    for en in entries:
        if en["kind"] == "line":
            r = line_record(en)
            if r is not None:
                recs.append(r)
            continue
        xy = bbox_xy(en)
        if xy is None or not any(rects_overlap(xy, r) for r in rects):
            continue
        z = bbox_z(en["elem"], None, en["tf"])
        if z is None:
            continue
        if en["kind"] == "wall":
            # A wall only counts when the plan cuts it.
            if not (z[0] - Z_TOL <= cut_z <= z[1] + Z_TOL):
                continue
        elif z[1] < zr[0] or z[0] > zr[1]:
            continue
        wdir = None
        if en["kind"] == "wall":
            crv = getattr(en["elem"].Location, "Curve", None)
            if crv is None or tname(crv) != "Line":
                warnings["curved"] = warnings.get("curved", 0) + 1
                continue
            a, b = crv.GetEndPoint(0), crv.GetEndPoint(1)
            if en["tf"] is not None:
                a, b = en["tf"].OfPoint(a), en["tf"].OfPoint(b)
            wdir = unit2(b.X - a.X, b.Y - a.Y)
            if wdir is None:
                continue
        faces, zmin, zmax = element_faces(en, opts_link if en["li"] is not None else opts_host, warnings)
        if not faces:
            continue
        key = (eid_int(en["li"].Id) if en["li"] is not None else -1, eid_int(en["elem"].Id))
        recs.append({"type": en["kind"], "key": key, "dir": wdir, "zmin": zmin, "zmax": zmax,
                     "faces": faces, "linked": en["li"] is not None, "role": en["role"],
                     "elem": en["elem"],
                     "cat": en["cat"]})
    return recs


def build_candidates(path, recs, settings):
    cands = []
    p0, d, L = path["p0"], path["dir"], path["len"]
    sdist = settings["search_distance_cm"] * FT_PER_CM
    for r in recs:
        role = r["role"]
        if r["type"] == "line":
            t = grid_hit(r["p0"], r["dir"], p0, d, L)
            if t is not None:
                cands.append({"t": t, "ref": r["ref"], "prio": PRIO_GRID,
                              "meta": {"kind": "grid", "role": role}})
            continue
        if r["type"] == "wall":
            kind = classify_wall(r["dir"], d)
            if kind is None:
                continue
        elif r["type"] == "family":
            kind = "near"
        else:
            kind = "perp"
        full_h = r["zmax"] - r["zmin"]
        start = len(cands)
        for f in r["faces"]:
            hit = face_hit(f, p0, d, L, kind, sdist)
            if hit is None:
                continue
            t, sign = hit
            partial = (f["zmax"] - f["zmin"]) < full_h - 10 * Z_TOL
            if role == "reference":
                prio = PRIO_REF_FACE
            else:
                prio = PRIO_LINK_FACE if r["linked"] else PRIO_HOST_FACE
            cands.append({"t": t, "ref": f["ref"], "prio": prio,
                          "meta": {"kind": "face", "wall": r["key"], "role": role,
                                   "wall_kind": kind if r["type"] == "wall" else "other",
                                   "sign": sign, "partial": partial,
                                   "zmin": f["zmin"], "zmax": f["zmax"]}})
        if r["type"] == "family" and len(cands) - start > 2:
            # A family contributes its outline only (first and last face along the line),
            # not every face of a frame, leaf or handle.
            mine = cands[start:]
            del cands[start:]
            cands.append(min(mine, key=lambda c: c["t"]))
            cands.append(max(mine, key=lambda c: c["t"]))
    return cands


def fmt_len(doc, v, dim_type=None):
    """Format a length like the dimension type does (falls back to project units)."""
    try:
        if dim_type is not None:
            fo = dim_type.GetUnitsFormatOptions()
            if fo is not None and not fo.UseDefault:
                fvo = DB.FormatValueOptions()
                fvo.SetFormatOptions(fo)
                return DB.UnitFormatUtils.Format(doc.GetUnits(), DB.SpecTypeId.Length, v, False, fvo)
    except Exception:
        pass
    try:
        return DB.UnitFormatUtils.Format(doc.GetUnits(), DB.SpecTypeId.Length, v, False)
    except Exception:
        return u"{0:.1f}".format(v * 30.48)


def cm(v):
    return u"{0:.1f}".format(v * 30.48)


def opening_debug(doc, path, meta, rec_by_key):
    """One report line per labelled opening, all values in cm relative to the path line z."""
    z0 = path["a"].Z
    key = meta.get("wall")
    rec = rec_by_key.get(key)
    line = u"  wall {0}: jamb z {1} to {2}".format(key[1], cm(meta["zmin"] - z0), cm(meta["zmax"] - z0))
    if rec is not None:
        line += u"; wall z {0} to {1}".format(cm(rec["zmin"] - z0), cm(rec["zmax"] - z0))
    if key[0] == -1:
        wall = rec.get("elem") if rec is not None else None
        if wall is not None:
            try:
                for iid in wall.FindInserts(True, False, False, False):
                    ins = doc.GetElement(iid)
                    hp = ins.get_Parameter(DB.BuiltInParameter.INSTANCE_HEAD_HEIGHT_PARAM)
                    sp = ins.get_Parameter(DB.BuiltInParameter.INSTANCE_SILL_HEIGHT_PARAM)
                    line += u"; insert {0} '{1}' sill {2} head {3}".format(
                        eid_int(iid), el_name(ins),
                        cm(sp.AsDouble()) if sp is not None else "?",
                        cm(hp.AsDouble()) if hp is not None else "?")
            except Exception:
                pass
    return line


def place_dimension(doc, view, path, clusters, dim_type, settings, report):
    ra = DB.ReferenceArray()
    for cl in clusters:
        ra.Append(cl["ref"])
    line = DB.Line.CreateBound(path["a"], path["b"])
    dim = doc.Create.NewDimension(view, line, ra, dim_type)
    if dim is None:
        raise Exception("Revit returned no dimension")
    small = 0
    openings = {}
    if settings["opening_text"] and path["mode"] == "detail":
        openings = find_openings(clusters, path["a"].Z)
    p0, d = path["p0"], path["dir"]
    starts = [cl["t"] for cl in clusters]

    def seg_index(origin):
        t = (origin.X - p0[0]) * d[0] + (origin.Y - p0[1]) * d[1]
        for i in range(len(starts) - 1):
            if starts[i] - MERGE_TOL <= t <= starts[i + 1] + MERGE_TOL:
                return i
        return None

    def label(i):
        h, sill = openings[i][0], openings[i][1]
        return opening_text(fmt_len(doc, h, dim_type), fmt_len(doc, sill, dim_type), settings["height_prefix"],
                            settings["sill_prefix"], sill > 10 * Z_TOL)

    if dim.NumberOfSegments == 0:
        if 0 in openings:
            dim.Below = label(0)
        v = dim.Value
        if v is not None and v < SMALL_SEGMENT:
            small += 1
    else:
        for seg in dim.Segments:
            v = seg.Value
            if v is not None and v < SMALL_SEGMENT:
                small += 1
            i = seg_index(seg.Origin)
            if i is not None and i in openings:
                seg.Below = label(i)
    report["openings"] += len(openings)
    for i in sorted(openings):
        report["opening_lines"].append(opening_debug(doc, path, openings[i][2], report["recs"]))
    report["small"] += small
    return dim


# ---------------------------------------------------------------------------
# Dialog
# ---------------------------------------------------------------------------
def show_dialog(dim_type_names, style_names, tree_data, s):
    """
    tree_data: {category: {label: count}}.
    Resizable dialog. Returns the new settings dict, or None when cancelled.
    """
    form = WF.Form()
    form.Text = "Smart Dimensions"
    form.StartPosition = WF.FormStartPosition.CenterScreen
    form.FormBorderStyle = WF.FormBorderStyle.Sizable
    form.MaximizeBox = True
    form.MinimizeBox = False
    form.Font = SD.Font("Segoe UI", 9)
    BW, BH = 600, 820                     # design size; anchors scale from here
    form.ClientSize = SD.Size(BW, BH)
    form.MinimumSize = SD.Size(480, 640)
    W, H = BW, BH
    try:
        W, H = int(s.get("dialog_size", [BW, BH])[0]), int(s.get("dialog_size", [BW, BH])[1])
    except Exception:
        pass

    A = WF.AnchorStyles
    TLR = A.Top | A.Left | A.Right
    BR = A.Bottom | A.Right
    BLR = A.Bottom | A.Left | A.Right
    ALL = A.Top | A.Bottom | A.Left | A.Right
    x0, cw = 12, BW - 24
    y = [10]

    def place(parent, ctrl, x, yy, w, h, anchor):
        ctrl.Location = SD.Point(x, yy)
        ctrl.Size = SD.Size(w, h)
        ctrl.Anchor = anchor
        parent.Controls.Add(ctrl)
        return ctrl

    def top_label(text):
        l = WF.Label()
        l.Text = text
        place(form, l, x0, y[0], cw, 18, TLR)
        y[0] += 20

    def top_combo(items, current):
        c = WF.ComboBox()
        c.DropDownStyle = WF.ComboBoxStyle.DropDownList
        for it in items:
            c.Items.Add(it)
        if current in items:
            c.SelectedIndex = items.index(current)
        elif items:
            c.SelectedIndex = 0
        place(form, c, x0, y[0], cw, 24, TLR)
        y[0] += 32
        return c

    top_label("Dimension type")
    cb_dim = top_combo(dim_type_names, s["dimension_type"])
    top_label("Path line style for detailed strings")
    cb_detail = top_combo(style_names, s["detail_style"])
    none_item = "<none>"
    top_label("Path line style for overall strings (anchors + outer faces only; must differ from detailed)")
    cb_overall = top_combo([none_item] + style_names, s["overall_style"] or none_item)

    # ---- bottom block, built upwards from the bottom edge
    bottom = BH - 12
    btn_cancel = WF.Button()
    btn_cancel.Text = "Cancel"
    btn_cancel.DialogResult = WF.DialogResult.Cancel
    place(form, btn_cancel, x0 + cw - 100, bottom - 30, 100, 30, BR)
    btn_ok = WF.Button()
    btn_ok.Text = "Place dimensions"
    btn_ok.DialogResult = WF.DialogResult.OK
    place(form, btn_ok, x0 + cw - 250, bottom - 30, 140, 30, BR)
    form.AcceptButton = btn_ok
    form.CancelButton = btn_cancel
    yb = [bottom - 44]

    def field(text, val, width=90):
        yb[0] -= 28
        l = WF.Label()
        l.Text = text
        place(form, l, x0, yb[0] + 3, cw - width - 10, 18, BLR)
        t = WF.TextBox()
        t.Text = u"{0}".format(val)
        place(form, t, x0 + cw - width, yb[0], width, 24, BR)
        return t

    def check(text, val):
        yb[0] -= 24
        c = WF.CheckBox()
        c.Text = text
        c.Checked = bool(val)
        place(form, c, x0, yb[0], cw, 22, BLR)
        return c

    tb_sp = field("Sill height prefix (empty = no sill height)", s["sill_prefix"])
    tb_hp = field("Height prefix", s["height_prefix"])
    chk_open = check("Write opening height below wall opening segments", s["opening_text"])
    chk_report = check("Debug: show a report after placing", s.get("debug", False))
    chk_replace = check("Replace dimensions that already lie on the path lines", s["replace_existing"])
    tb_dist = field("Search distance for parallel walls and families (cm)", s["search_distance_cm"])

    # ---- category / type trees in two tabs
    tabs = WF.TabControl()
    place(form, tabs, x0, y[0] + 4, cw, yb[0] - y[0] - 12, ALL)
    cats = sorted(tree_data.keys(), key=lambda c: c.lower())

    links = {}   # title -> state of each tab, so a tab can see what the other one ticked

    def tree_tab(title, hint, saved, other_title):
        page = WF.TabPage()
        page.Text = title
        tabs.TabPages.Add(page)
        pw = cw - 8
        tv = WF.TreeView()
        tv.CheckBoxes = True
        tv.HideSelection = False
        tv.Dock = WF.DockStyle.Fill
        page.Controls.Add(tv)
        # Build the header completely before docking it, so anchors are computed against
        # its real width (a TabPage is still tiny at this point).
        head = WF.Panel()
        head.Size = SD.Size(pw, 86)
        hint_l = WF.Label()
        hint_l.Text = hint
        place(head, hint_l, 2, 4, pw - 4, 18, TLR)
        tb = WF.TextBox()
        place(head, tb, 2, 26, pw - 6, 24, TLR)
        # Second row: auto-sized controls in a flow panel, so text never gets clipped
        # at higher Windows display scaling.
        row = WF.FlowLayoutPanel()
        row.FlowDirection = WF.FlowDirection.LeftToRight
        row.WrapContents = False
        place(head, row, 0, 52, pw, 32, TLR)
        only = WF.CheckBox()
        only.Text = "Show ticked only"
        only.AutoSize = True
        only.Margin = WF.Padding(3, 7, 12, 3)
        row.Controls.Add(only)
        b_all = WF.Button()
        b_all.Text = "Tick shown"
        b_all.AutoSize = True
        row.Controls.Add(b_all)
        b_none = WF.Button()
        b_none.Text = "Untick shown"
        b_none.AutoSize = True
        row.Controls.Add(b_none)
        head.Dock = WF.DockStyle.Top
        page.Controls.Add(head)
        cnt = WF.Label()
        cnt.Dock = WF.DockStyle.Bottom
        cnt.Height = 20
        page.Controls.Add(cnt)
        tv.BringToFront()

        checked = {}
        for c in cats:
            for l in tree_data[c]:
                checked[type_key(c, l)] = type_key(c, l) in saved
        st = {"busy": False, "shown": []}

        def blocked(k):
            """A type ticked in the other tab cannot be ticked here."""
            o = links.get(other_title)
            return bool(o and o["checked"].get(k))

        def count_text():
            n = sum(1 for v in checked.values() if v)
            cnt.Text = "{0} of {1} types ticked".format(n, len(checked))

        def rebuild():
            st["busy"] = True
            tv.BeginUpdate()
            tv.Nodes.Clear()
            shown = []
            for c in cats:
                labels = filter_labels(sorted(tree_data[c].keys(), key=lambda x: x.lower()),
                                       tb.Text, prefix=c)
                if only.Checked:
                    labels = [l for l in labels if checked[type_key(c, l)]]
                if not labels:
                    continue
                cn = tv.Nodes.Add(u"{0}   ({1})".format(c, len(tree_data[c])))
                cn.Tag = u"CAT|" + c
                for l in labels:
                    k = type_key(c, l)
                    if blocked(k):
                        checked[k] = False
                        tn = cn.Nodes.Add(u"{0}   ({1})   - used in {2}".format(l, tree_data[c][l], other_title))
                        tn.ForeColor = SD.Color.Gray
                    else:
                        tn = cn.Nodes.Add(u"{0}   ({1})".format(l, tree_data[c][l]))
                        shown.append(k)
                    tn.Tag = k
                    tn.Checked = checked[k]
                free = [type_key(c, l) for l in labels if not blocked(type_key(c, l))]
                cn.Checked = bool(free) and all(checked[k] for k in free)
                if tb.Text.strip() or only.Checked or any(checked[type_key(c, l)] for l in labels):
                    cn.Expand()
            st["shown"] = shown
            tv.EndUpdate()
            st["busy"] = False
            count_text()

        def before_check(sender, e):
            if st["busy"]:
                return
            tag = u"{0}".format(e.Node.Tag)
            if not tag.startswith(u"CAT|") and blocked(tag):
                e.Cancel = True

        def after_check(sender, e):
            if st["busy"]:
                return
            node = e.Node
            tag = u"{0}".format(node.Tag)
            st["busy"] = True
            try:
                if tag.startswith(u"CAT|"):
                    for ch in node.Nodes:
                        k = u"{0}".format(ch.Tag)
                        if blocked(k):
                            continue
                        ch.Checked = node.Checked
                        checked[k] = bool(node.Checked)
                else:
                    checked[tag] = bool(node.Checked)
                    par = node.Parent
                    if par is not None:
                        free = [ch for ch in par.Nodes if not blocked(u"{0}".format(ch.Tag))]
                        par.Checked = bool(free) and all(ch.Checked for ch in free)
            finally:
                st["busy"] = False
            count_text()

        def set_shown(val):
            for k in st["shown"]:
                checked[k] = val
            rebuild()

        tv.BeforeCheck += before_check
        tv.AfterCheck += after_check
        tb.TextChanged += lambda sender, e: rebuild()
        only.CheckedChanged += lambda sender, e: rebuild()
        b_all.Click += lambda sender, e: set_shown(True)
        b_none.Click += lambda sender, e: set_shown(False)
        links[title] = {"checked": checked, "rebuild": rebuild}
        return checked

    # A type belongs to one tab only; old settings with a type in both keep it as Reference.
    ref_saved = set(s["ref_types"])
    dim_saved = set(s["dim_types"]) - ref_saved
    dim_checked = tree_tab("Dimension", "Elements to dimension (walls also give openings and opening heights).",
                           dim_saved, "Reference")
    ref_checked = tree_tab("Reference", "Fixed references, like grids and structural walls (anchors of a string).",
                           ref_saved, "Dimension")
    for t in links.values():
        t["rebuild"]()
    tabs.SelectedIndexChanged += lambda sender, e: [t["rebuild"]() for t in links.values()]

    form.ClientSize = SD.Size(max(W, 480), max(H, 600))
    result = form.ShowDialog()
    size = [form.ClientSize.Width, form.ClientSize.Height]
    if result != WF.DialogResult.OK:
        return None

    try:
        dist = float(tb_dist.Text.replace(",", "."))
    except Exception:
        dist = DEFAULT_SETTINGS["search_distance_cm"]
    overall = cb_overall.SelectedItem

    def merged(checked, saved):
        # keep saved ticks of types that are not in this view
        return sorted(set([k for k, v in checked.items() if v] + [k for k in saved if k not in checked]))

    out = dict(s)
    out.update({
        "dimension_type": cb_dim.SelectedItem,
        "detail_style": cb_detail.SelectedItem,
        "overall_style": "" if overall in (None, none_item) else overall,
        "dim_types": merged(dim_checked, s["dim_types"]),
        "ref_types": merged(ref_checked, s["ref_types"]),
        "search_distance_cm": dist,
        "replace_existing": bool(chk_replace.Checked),
        "debug": bool(chk_report.Checked),
        "opening_text": bool(chk_open.Checked),
        "height_prefix": tb_hp.Text,
        "sill_prefix": tb_sp.Text,
        "dialog_size": size,
    })
    out["_dim_now"] = [k for k, v in dim_checked.items() if v]
    out["_ref_now"] = [k for k, v in ref_checked.items() if v]
    return out


# ---------------------------------------------------------------------------
# Main
# ---------------------------------------------------------------------------
def main():
    doc = DocumentManager.Instance.CurrentDBDocument
    view = doc.ActiveView
    if tname(view) != "ViewPlan":
        return "Open a floor plan view and run again (active view: {0}).".format(view.Name)

    s = load_settings()
    dim_types = collect_dimension_types(doc)
    styles = collect_line_styles(doc)
    if not dim_types:
        return "No linear dimension types found in the model."

    # ProjectElevation is in the same coordinates as the geometry; the real floor z
    # is taken from the path lines after the dialog.
    floor_guess = view.GenLevel.ProjectElevation if view.GenLevel is not None else 0.0
    entries = collect_entries(doc, view, floor_guess)
    tree = {}
    for en in entries:
        d = tree.setdefault(en["cat"], {})
        d[en["label"]] = d.get(en["label"], 0) + 1
    if not s.get("dim_types") and not s.get("ref_types"):
        # First run: grids as references, like a drafter would.
        grid_cat = None
        for en in entries:
            if tname(en["elem"]) == "Grid":
                grid_cat = en["cat"]
                break
        if grid_cat:
            s["ref_types"] = [type_key(grid_cat, l) for l in tree.get(grid_cat, {})]

    res = show_dialog(sorted(dim_types.keys(), key=lambda x: x.lower()),
                      sorted(styles.keys(), key=lambda x: x.lower()), tree, s)
    if res is None:
        return "Cancelled."
    dim_now = set(res.pop("_dim_now"))
    ref_now = set(res.pop("_ref_now"))
    notes = []
    if res["overall_style"] and res["overall_style"] == res["detail_style"]:
        # Same style for both would turn every string into an overall string.
        res["overall_style"] = ""
        notes.append("Overall style was the same as the detailed style: ignored, all strings placed as detailed.")
    save_settings(res)
    if not dim_now and not ref_now:
        return "Nothing ticked. Nothing placed."

    dim_type = dim_types.get(res["dimension_type"])
    style_ids = {}
    if res["detail_style"] in styles:
        style_ids[eid_int(styles[res["detail_style"]])] = "detail"
    if res["overall_style"] and res["overall_style"] in styles:
        style_ids[eid_int(styles[res["overall_style"]])] = "overall"
    paths, skipped_curved_paths = collect_paths(doc, view, style_ids)
    if not paths:
        return ("No straight lines with style '{0}'{1} found in this view."
                .format(res["detail_style"],
                        " or '{0}'".format(res["overall_style"]) if res["overall_style"] else ""))

    floor_z = paths[0]["a"].Z
    cut_z = cut_plane_z(doc, view, floor_z)
    zr = view_z_range(doc, view, floor_z)

    chosen = []
    for en in entries:
        k = type_key(en["cat"], en["label"])
        if k in ref_now:
            en["role"] = "reference"
        elif k in dim_now:
            en["role"] = "dimension"
        else:
            continue
        chosen.append(en)

    warnings = {}
    sdist = res["search_distance_cm"] * FT_PER_CM
    recs = build_records(chosen, view, paths, cut_z, zr, sdist, warnings)

    both = sorted(dim_now & ref_now)
    if both:
        notes.append("Ticked in both tabs, used as Reference only (no opening heights): " +
                     ", ".join(k.split("|", 1)[1] for k in both[:8]) + (" ..." if len(both) > 8 else ""))
    report = {"placed": 0, "failed": [], "openings": 0, "small": 0, "deleted": 0, "empty": 0,
              "jambs": 0, "opening_lines": [],
              "recs": dict((r["key"], r) for r in recs if r["type"] != "line")}
    TransactionManager.Instance.EnsureInTransaction(doc)
    try:
        if res["replace_existing"]:
            report["deleted"] = delete_dims_on_paths(doc, view, paths)
        for p in paths:
            clusters = merge_candidates(build_candidates(p, recs, res))
            if p["mode"] == "overall":
                clusters = overall_filter(clusters)
            report["jambs"] += sum(1 for cl in clusters if any(
                m.get("wall_kind") == "par" and m.get("partial") and m.get("role") == "dimension"
                for m in cl["metas"]))
            if len(clusters) < 2:
                report["empty"] += 1
                continue
            try:
                place_dimension(doc, view, p, clusters, dim_type, res, report)
                report["placed"] += 1
            except Exception as ex:
                report["failed"].append("line {0}: {1}".format(eid_int(p["elem"].Id), ex))
    finally:
        TransactionManager.Instance.TransactionTaskDone()

    by_cat = {}
    for r in recs:
        c = r.get("cat", "Grids / reference planes") if r["type"] != "line" else "Grids / reference planes"
        by_cat[c] = by_cat.get(c, 0) + 1
    lines = [
        "Path lines found: {0} ({1} detailed, {2} overall)".format(
            len(paths), sum(1 for p in paths if p["mode"] == "detail"),
            sum(1 for p in paths if p["mode"] == "overall")),
        "Dimension strings placed: {0}".format(report["placed"]),
        "Opening jamb faces found: {0}; opening segments labelled with height: {1}".format(
            report["jambs"], report["openings"]),
        "Elements near the path lines: " + (", ".join(
            "{0} {1}".format(n, c) for c, n in sorted(by_cat.items())) or "none"),
    ] + notes
    if report["opening_lines"]:
        lvl = view.GenLevel
        lines.append("Openings (cm, relative to the path line z = {0}; level '{1}' project elevation = {2}):".format(
            cm(paths[0]["a"].Z), lvl.Name if lvl is not None else "?",
            cm(lvl.ProjectElevation) if lvl is not None else "?"))
        lines.extend(report["opening_lines"][:30])
    if report["deleted"]:
        lines.append("Old dimensions replaced: {0}".format(report["deleted"]))
    if report["empty"]:
        lines.append("Path lines with fewer than 2 references (skipped): {0}".format(report["empty"]))
    if report["small"]:
        lines.append("Segments under 5 cm (check text overlap): {0}".format(report["small"]))
    if skipped_curved_paths:
        lines.append("Curved path lines skipped: {0}".format(skipped_curved_paths))
    if warnings.get("curved"):
        lines.append("Curved walls skipped: {0}".format(warnings["curved"]))
    if warnings.get("linkref"):
        lines.append("Linked faces that could not be referenced: {0}".format(warnings["linkref"]))
    if warnings.get("instref"):
        lines.append("Family faces that could not be referenced: {0}".format(warnings["instref"]))
    if report["failed"]:
        lines.append("Failed strings:")
        lines.extend("  " + f for f in report["failed"])
    return "\n".join(lines)


def show_report(text):
    try:
        if load_settings().get("debug", False):
            WF.MessageBox.Show(text, "Smart Dimensions")
    except Exception:
        pass


if REVIT:
    try:
        OUT = main()
    except Exception:
        OUT = "Error:\n" + traceback.format_exc()
    if OUT != "Cancelled.":
        show_report(OUT)
# ----------------------------------------
